% Simulink data dictionary PunchEV_Data.sldd

PunchEV = struct(
  Vehicle=struct(Mass_kg=1340, CG_Front_m=1.1, CG_Rear_m=1.35, CG_Height_m=0.5, FrontalArea_m2=2.4, Cd=0.32),
  Road=struct(AirDensity_kgm3=1.225, RollingResistanceCoeff=0.012, AirDensity_kg_per_m3=1.225),
  Constants=struct(g=9.81),
  Battery=struct(
    NominalVoltage_V=320,
    Standard=struct(Capacity_kWh=25, Capacity_Ah=78.125, InternalResistance_Ohm=0.05),
    LongRange=struct(Capacity_kWh=35, Capacity_Ah=109.375, InternalResistance_Ohm=0.045)),
  Motor=struct(
    FieldType="PermanentMagnet",
    ModelParamType="RatedLoadSpeed",
    DC_BusVoltage_V=320,
    RatedPower_kW=75,
    RatedSpeed_rpm=3800,
    NoLoadSpeed_rpm=10000,
    ArmatureInductance_H=0.0005,
    RotorInertia_gcm2=300000,
    RotorDamping_Nm_s_rad=0.001,
    InitialSpeed_rpm=0,
    PeakTorque_Nm=190,
    PeakPower_kW=90),
  Tire=struct(
    ParameterizationMethod="PeakForceAndSlip",
    RatedVerticalLoad_N=3000,
    PeakLongForce_N=3500,
    SlipAtPeak_percent=10,
    RollingRadius_m=0.3,
    RollingResistanceEnable=false,
    Crr=0.012,
    ComplianceModel="NoCompliance",
    InertiaModel="NoInertia",
    VxLowLimit_mps=1,
    VelocityThreshold_mps=0.1,
    KPUMIN=-1.5,
    KPUMAX=1.5))